# Grasshopper definition main.gh (Grasshopper 1.0.7)
# plug-ins: Human UI, Human, Hops

viewport_properties = ViewportProperties(Update=True, AutoUpdate=True)  # -> ViewportNames, ActiveViewportIndex, ViewportBounds, ViewportDisplayMode, CameraLocation, CameraTarget, CameraPlane, CameraLensLength, CameraProjection, CameraUp
default_options = Panel("""-s50
-n1
-v0.5""")

trigger = Trigger(Interval=-5000, TimerInterval=5000, Target=save_viewport_to_file)  # disabled
boolean_toggle = BooleanToggle(True)

strength = Slider(0.7, range=0.1..0.95)
image_size = Slider(512, range=256..1024)
tags = Panel("""modernist
brutalist
Vienna
Newyork
Shanghai
Photography""")
get_gh_filepath = CSharpScript()  # -> A
# ---------- get_gh_filepath: C# ----------
A = GrasshopperDocument.FilePath;
# ---------- end get_gh_filepath ----------
env = Panel("conda activate ldm")
script = Panel("python scripts\dream.py --socket")
ghpython_script = GhPythonScript(x=get_gh_filepath)  # -> a
# ---------- ghpython_script: Python ----------
__author__ = "DueringS"
__version__ = "2022.10.09"

import rhinoscriptsyntax as rs

temp = x.split("\\")[-1]
a = x.replace(temp, "")
print a
# ---------- end ghpython_script ----------
create_text_box = CreateTextBox(Label="viewport name", DefaultText="Perspective", UpdateButton=True, showLabel=True)
create_text_box_2 = CreateTextBox(Label="path to stable-diffusion folder", DefaultText="...", UpdateButton=True, showLabel=True)
create_text_box_3 = CreateTextBox(Label="prompt", DefaultText="a space cow is grazing on the moon", UpdateButton=True, showLabel=True)
create_button = CreateButton(ButtonName="update image", ButtonStyle=0)
create_button_2 = CreateButton(ButtonName="copy", ButtonStyle=0)
create_slider = CreateSlider(Slider=strength, ShowBounds=False, ShowTicks=False, ShowTooltip=False, ShowValLabel=True, showLabel=True)
create_slider_2 = CreateSlider(Slider=image_size, ShowBounds=False, ShowTicks=False, ShowTooltip=False, ShowValLabel=True, showLabel=True)
create_toggle = CreateToggle(Default=False, Label=tags, OnLabel="    ", OffLabel="    ")
concatenate = Concatenate(FragmentA=ghpython_script, FragmentB="stableDiffusionSocket.gh")
concatenate_2 = Concatenate(FragmentA=ghpython_script, FragmentB="RhinoLive.png")
value_listener = ValueListener(Elements=create_button_2, SomeProperty=True)  # -> Values, Indices
value_listener_2 = ValueListener(Elements=create_slider, SomeProperty=True)  # -> Values, Indices
value_listener_3 = ValueListener(Elements=create_slider_2, SomeProperty=True)  # -> Values, Indices
value_listener_4 = ValueListener(Elements=create_text_box, SomeProperty=True)  # -> Values, Indices
ghpython_script_2 = GhPythonScript(
    pxSize=value_listener_3.Values,
    name=value_listener_4.Values,
    names=viewport_properties.ViewportNames,
    bds=viewport_properties.ViewportBounds)  # -> factor; inputs names: list, bds: list of Rectangle3d
# ---------- ghpython_script_2: Python ----------
__author__ = "DueringS"
__version__ = "2022.10.09"

import rhinoscriptsyntax as rs

for i, n in enumerate(names):
    if n == name:
        aa = pxSize / bds[i].Width
        factor = round(aa,1)
# ---------- end ghpython_script_2 ----------
value_listener_5 = ValueListener(Elements=create_text_box_2, SomeProperty=True)  # -> Values, Indices
ghpython_script_3 = GhPythonScript(stPath=value_listener_5.Values)  # -> flatten(a)
# ---------- ghpython_script_3: Python ----------
__author__ = "DueringS"
__version__ = "2022.10.09"

import rhinoscriptsyntax as rs

a = "CD " + stPath[:-1]
# ---------- end ghpython_script_3 ----------
merge = Merge(Data1=env, Data2=ghpython_script_3, Data3=script)
value_listener_6 = ValueListener(Elements=create_text_box_3, SomeProperty=True)  # -> flatten(Values), Indices
value_listener_7 = ValueListener(Elements=create_toggle, SomeProperty=True)  # -> flatten(Values), Indices
value_listener_8 = ValueListener(Elements=create_button, SomeProperty=True)  # -> Values, Indices
save_viewport_to_file = SaveViewportToFile(
    Run=value_listener_8.Values,
    ViewportName=value_listener_4.Values,
    Render=False,
    FilePath=concatenate_2,
    ScaleFactor=ghpython_script_2)

# ---- group: preview anaconda command
copytexttoclipboard = CSharpScript(x=flatten(merge), y=value_listener.Values)  # -> out, A; inputs x: list of String
# ---------- copytexttoclipboard: C# usings ----------
using System.Windows.Forms;
# ---------- copytexttoclipboard: C# ----------
    string newText = "";
    for (int i = 0; i < x.Count; i++)
    {
      newText += x[i];
      newText += System.Environment.NewLine;
    }
    System.Windows.Forms.Clipboard.SetText(newText);
    A = newText;
# ---------- end copytexttoclipboard ----------
tb = CreateTextBlock(Text="command", TextSize=12, Justification=0)
settextblock = SetTextBlockContents(TextBlockToModify=tb, NewTextBlockContents=copytexttoclipboard.A)

# ----
ghpython_script_4 = GhPythonScript(prompt=value_listener_6.Values, txt=tags, state=value_listener_7.Values)  # -> a; inputs txt: list, state: list
# ---------- ghpython_script_4: Python ----------
__author__ = "DueringS"
__version__ = "2022.10.09"

import rhinoscriptsyntax as rs

promptFinal = prompt

for i, t in enumerate(txt):
    if state[i] == True:
        promptFinal += ", " + t

a = promptFinal
# ---------- end ghpython_script_4 ----------
ghpython_script_5 = GhPythonScript(x=save_viewport_to_file)  # -> a
# ---------- ghpython_script_5: Python ----------
__author__ = "DueringS"
__version__ = "2022.10.05"

import rhinoscriptsyntax as rs
import time
b = time.time()
a = str(b)[5:]
print str(a)[5:]
# ---------- end ghpython_script_5 ----------
merge_2 = Merge(Data1=tb, Data2=create_button_2)
create_separator = CreateSeparator(Thickness=0.5, Horizontal=True, Color=RGB(0, 0, 0), Width=100, Height=15)
create_stack = CreateStack(UIElements=merge_2, Horizontal=True)
adjust_element_positioning = AdjustElementPositioning(ElementsToAdjust=create_stack, AbsolutePositioning=False, HorizontalAlignment=1)
create_wrappanel = CreateWrapPanel(UIElements=create_toggle, Horizontal=True)
merge_3 = Merge(Data1=create_button)
hops = Hops(
    _Path=concatenate,
    Prompt=ghpython_script_4,
    Seed=Slider(7587, range=0..9999),
    ImgPath=save_viewport_to_file,
    ModelOptions=default_options,
    Strength=value_listener_2.Values,
    CacheResultsInMemory=False,
    CacheSolveResults=False,
    RemoteDefinitionLocation="C:\Users\dueringS\ProjekteWS\GH_stableDiffusion\stableDiffusionSocket.gh",
    RemoteSolveVersion=(0, 1, 0),
    ShowInput_Enabled=False,
    ShowInput_Path=True,
    SynchronousSolve=False)
merge_4 = Merge(
    Data1=create_slider,
    Data2=create_slider_2,
    Data3=create_text_box,
    Data4=create_text_box_2,
    Data5=create_separator,
    Data6=create_stack)
create_stack_2 = CreateStack(UIElements=merge_3, Horizontal=True)
create_view_box = CreateViewBox(UIElements=create_wrappanel, Width=350, Height=60)

data_recorder = DataRecorder(hops, DataLimit=1, RecordData=True)
concatenate_3 = Concatenate(A=value_listener_5.Values, Fragment_A="\", Fragment_B=data_recorder)
create_image = CreateImage(ImageSource=concatenate_3, ImageWidth=600, ImageHeight=400)

create_expander = CreateExpander(UIElements=merge_4, Header="settings", Open=True)
adjust_element_appearance = AdjustElementAppearance(ElementsToAdjust=create_expander, Foreground=RGB(0, 0, 0), Background=RGB(224, 224, 224), FontSize=12)
merge_5 = Merge(
    Data1=flatten(create_expander),
    Data2=flatten(create_text_box_3),
    Data3=flatten(create_view_box),
    Data4=flatten(create_image),
    Data5=flatten(merge_3))

launch_window = LaunchWindow(Show=Toggle(True), Name="Control Window", Width=370, Height=400, ChildStatus=0, EnableHorizScroll=False)
add_elements = AddElements(Window=launch_window, Elements=flatten(merge_5), DoVLChecking=True)  # -> AddedElements, ElementNames

set_window_properties = SetWindowProperties(Window=launch_window, ShowTitleBar=Toggle(False), ScaleFactor=1)
